# Grasshopper definition 3dPointGridPattern.gh (Grasshopper 1.0.7)
# plug-ins: Bifocals

point = Point(<point referenced from the Rhino model>)
point_2 = Point(<point referenced from the Rhino model>)
ghpython_script = GhPythonScript(p0=point, p1=point_2, x_num=Slider(25, range=0..100), y_num=Slider(30, range=0..100), mode=Slider(3, range=0..3))  # -> out, a; inputs x_num: Int32, y_num: Int32
# ---------- ghpython_script: Python ----------
import rhinoscriptsyntax as rs

def dis2(p0, p1):
    pos0 = rs.PointCoordinates(p0)
    pos1 = rs.PointCoordinates(p1)
    dis = (pos1[0] - pos0[0]) * (pos1[0] - pos0[0]) + (pos1[1] - pos0[1]) * (pos1[1] - pos0[1]) + (pos1[2] - pos0[2]) * (pos1[2] - pos0[2])
    return dis

pos0 = rs.PointCoordinates(p0)
pos1 = rs.PointCoordinates(p1)

x_interval = (pos1[0] - pos0[0]) / (x_num - 1)
y_interval = (pos1[1] - pos0[1]) / (y_num - 1)
pts = []

for i in range(x_num):
    for j in range(y_num):
        x = pos0[0] + x_interval * i 
        y = pos0[1] + y_interval * j
        z = 0
        
        if mode == 0:
            if (i * j) & 2 == 0:
                p = rs.AddPoint(x, y, z)            
                pts.append(p)
            
        elif mode == 1:
            if (i*j + i*j) & 2 == 0:
                p = rs.AddPoint(x, y, z)            
                pts.append(p)
            
        elif mode == 2:
            if (i*j - i*j) & 2 == 0:
                p = rs.AddPoint(x, y, z)            
                pts.append(p)
            
        elif mode == 3:
            if (i*j - i-j) & 2 == 0:
                p = rs.AddPoint(x, y, z)            
                pts.append(p)
                
    for j in range(len(pts)-1):
        p0 = pts[j]
        for i in range(j, len(pts)):
            p1 = pts[i]
            dis = dis2(p0, p1)
            print(dis)
a = pts
# ---------- end ghpython_script ----------
