# Grasshopper definition Function1D.gh (Grasshopper 1.0.7)
# plug-ins: Bifocals

number_slider = Slider(3.194605, range=-360..360)
ghpython_script = GhPythonScript(
    min=Slider(-100, range=-100..100),
    max=Slider(100, range=-100..100),
    scale=Slider(0.02, range=0..5),
    a=Slider(5, range=0..10),
    b=Slider(0, range=-100..100))  # -> out, a
# ---------- ghpython_script: Python ----------
import rhinoscriptsyntax as rs
import math

pts = []

for i in range(int(min), int(max)):
    x = i * scale
#   y = x * a
    y = math.pow(x, a) + b                    # degree
    z = 0
    
    p = rs.AddPoint(x,y,z)
    pts.append(p)
    
a = pts
# ---------- end ghpython_script ----------
panel = Panel(ghpython_script.a)
