# Grasshopper definition BasicTruss.gh (Grasshopper 1.0.7)

ghpython_script = GhPythonScript(xNum=Slider(11, range=0..100), scale=Slider(14, range=0..100))  # -> out, a, b, c; inputs xNum: Int32, yNum: Int32
# ---------- ghpython_script: Python ----------
import rhinoscriptsyntax as rs

pts = []
lns = []
pps = []

for i in range(xNum):
    for j in range(2):
        p = rs.AddPoint(i * scale, 0, j*scale)
        p = rs.PointCoordinates(p)
        pts.append(p)

for k in range(xNum * 2 - 1):
    lns.append(rs.AddLine(pts[k], pts[k+1]))

for l in range(xNum * 2 - 2):
    lns.append(rs.AddLine(pts[l], pts[l+2]))

for m in range(len(lns)):
    print(m)
    pipe = rs.AddPipe(lns[m], 0, 0.5)
    pps.append(pipe)

a = rs.AddPipe(lns[0], 0, 0.5)
c = rs.AddPipe(lns[1], 0, 0.5)


#a = pts
b = lns
# ---------- end ghpython_script ----------
panel = Panel(ghpython_script.b)
panel_2 = Panel(ghpython_script.c)
