# Grasshopper definition CruvedSrf.gh (Grasshopper 1.0.7)

number_slider = Slider(37, range=0..100)
negative = Negative(Value=number_slider)
ghpython_script = GhPythonScript(x=number_slider)  # -> out, a; inputs x: Int32
# ---------- ghpython_script: Python ----------
import rhinoscriptsyntax as rs
import Rhino.Geometry as rg

rec = rs.AddRectangle([-x,-x,0], x*2, x*2)
rs.div

a = rec
# ---------- end ghpython_script ----------
construct_domain = ConstructDomain(DomainStart=negative, DomainEnd=number_slider)
number_slider_2 = Slider(10, range=0..10)
rectangle = Rectangle(Plane=PlaneXY(0, 0, 0), XSize=construct_domain, YSize=construct_domain, Radius=0)  # -> Rectangle, Length
divide_surface = DivideSurface(Surface=rectangle.Rectangle, UCount=number_slider_2, VCount=number_slider_2)  # -> flatten(Points), Normals, Parameters
construct_domain_2 = ConstructDomain(DomainStart=Slider(10, range=0..10), DomainEnd=Slider(23, range=0..100))
list_length = ListLength(List=divide_surface.Points)
random = Random(Range=construct_domain_2, Number=list_length, Seed=2)
amplitude = Amplitude(Vector=divide_surface.Normals, Amplitude=random)
move = Move(Geometry=divide_surface.Points, Motion=amplitude)  # -> Geometry, Transform
addition = Addition(A=number_slider_2, B="1")
colour_picker = ColourPicker(PickedColour=RGB(76, 186, 157))
surface_from_points = SurfaceFromPoints(Points=move.Geometry, UCount=addition, Interpolate=Toggle(True))
custom_preview = CustomPreview(Geometry=surface_from_points, Material=colour_picker)
