# Grasshopper definition shadowAnalysis.gh (Grasshopper 1.0.7)

number_slider = Slider(23, range=0..100)

# ---- group: building heights
merge = Merge(
    Data1=Slider(54, range=0..110),
    Data2=Slider(50, range=0..110),
    Data3=Slider(46, range=0..110),
    Data4=Slider(73, range=0..110),
    Data5=Slider(0, range=-1..0),
    Data6=Slider(31, range=0..110),
    Data7=Slider(110, range=0..110),
    Data8=Slider(110, range=0..110),
    Data9=Slider(70, range=0..110))

# ---- group: surround mass
ghpython_script = GhPythonScript(massHeight=number_slider)  # -> out, mass1, mass2, mass1Crv, mass2Crv; inputs massHeight: Int32
# ---------- ghpython_script: Python ----------
import Rhino.Geometry as rg
import rhinoscriptsyntax as rs
import ghpythonlib.components as gh

x = massHeight
path = rs.AddLine(rs.AddPoint(0,0,0), rs.AddPoint(0,0,x*2))

mass1Crv = rs.AddRectangle([x*4,0,0], x*3, x*3)
mass1 = rs.ExtrudeCurve(mass1Crv, path)
rs.CapPlanarHoles(mass1)

mass2Crv = rs.AddRectangle([0,x*4,0], x*5, x*5)
#mass2 = rs.ExtrudeCurve(mass2Crv, path)
#rs.CapPlanarHoles(mass2)
# ---------- end ghpython_script ----------

# ---- group: base
ghpython_script_2 = GhPythonScript(recSize=number_slider, recNum=Slider(3, range=0..10), heightList=merge, floorHeight=Slider(4.5, range=0..10))  # -> out, baseRec, heightList, bdgs, bdgsArea, contour; inputs recSize: Int32, recNum: Int32, heightList: list
# ---------- ghpython_script_2: Python ----------
import Rhino.Geometry as rg
import rhinoscriptsyntax as rs
import ghpythonlib.components as gh

baseRec = []
for i in range(recNum):
    for j in range(recNum):
        base = rs.AddRectangle([i*recSize,j*recSize,0], recSize, recSize)
        baseRec.append(base)


bdgs = []
heightList = [i*floorHeight for i in heightList]
for i in range(len(baseRec)):
    path = rs.AddLine(rs.AddPoint(0,0,0), rs.AddPoint(0,0,heightList[i]))
    if heightList[i] == 0:
        path = rs.AddLine(rs.AddPoint(0,0,0), rs.AddPoint(0,0,max(heightList)))
    bldg = rs.coercebrep(rs.ExtrudeCurve(baseRec[i], path))
    rs.CapPlanarHoles(bldg)
    bdgs.append(bldg)

bdgs = gh.CapHoles(bdgs)


contour = []
basePoint = rs.coerce3dpoint(rs.AddPoint(0,0,0))
endPoint = rs.coerce3dpoint(rs.AddPoint(0,0,max(heightList)))
for i in range(len(bdgs)):
    contourCrv = rg.Brep.CreateContourCurves(bdgs[i], basePoint, endPoint, floorHeight)
    contour.append(contourCrv)


bdgsArea = 0
for i in range(len(contour)):
    bdgsArea += len(contour[i])*23**2 - 23**2
# ---------- end ghpython_script_2 ----------

# ----
building_height = Panel(ghpython_script_2.heightList)
building_floor_area = Panel(ghpython_script_2.bdgsArea)

# ---- group: environment
ghpython_script_3 = GhPythonScript(
    baseRec=ghpython_script_2.baseRec,
    rad=Slider(550, range=0..1000),
    u=Slider(0.6, range=0..1),
    v=Slider(0.9, range=0.5..1))  # -> out, sunPath, sunPt, sun, ground, isoCrv, vector; inputs baseRec: list
# ---------- ghpython_script_3: Python ----------
import Rhino.Geometry as rg
import rhinoscriptsyntax as rs
import ghpythonlib.components as gh
import Grasshopper.Kernel.Types as gt

plane = [0,0,0]
sunPath = rs.coercebrep(rs.AddSphere(plane, rad))
ground = rs.coercecurve(rs.AddCircle(plane, rad))
ground = gh.BoundarySurfaces(ground)
sunPath = rs.coercesurface(gh.SplitBrep(sunPath, ground)[0])

dom = rg.Interval(0.00, 1.00)
sunPath.SetDomain(0, dom)
sunPath.SetDomain(1, dom)
sunPt = rs.EvaluateSurface(sunPath, u, v)
sun = rs.AddSphere(sunPt, 35)

#print(gt.GH_Surface(sunPath))
#print(rs.coercesurface(sunPath))

crvPt = gh.ConstructPoint(u,v,0)
isoCrv = gh.IsoCurve(gt.GH_Surface(sunPath), crvPt)
isoCrv = rs.MoveObjects(isoCrv, [0,0,0])

vecPt1 = rs.coerce3dpoint(sunPt)
vecPt2 = rs.CurveAreaCentroid(baseRec[0])[0]
vector = gh.Vector2Pt(vecPt1, vecPt2, False)[0]

#vecDisplay = gh.VectorDisplay(vecPt1, vector)
# ---------- end ghpython_script_3 ----------

# ----
surface = Surface(ghpython_script_3.sunPath)
point = Point(ghpython_script_3.sunPt)
brep = Brep(ghpython_script_3.sun)
geometry = Geometry(ghpython_script_3.isoCrv)
vector = Vector(ghpython_script_3.vector)
amplitude = Amplitude(Vector=vector, Amplitude=Slider(200, range=0..1000))
merge_2 = Merge(Data1=ghpython_script.mass1Crv, Data2=ghpython_script.mass2Crv)
vector_display = VectorDisplay(Anchor=point, Vector=amplitude)
mesh = Mesh(ghpython_script_2.bdgs)
vector_2 = Vector(amplitude)

# ---- group: shadow analysis
ghpython_script_4 = GhPythonScript(bdgs=mesh, vector=vector_2, massCrvs=merge_2)  # -> out, shadow, shadowArea, mass1ShadArea, greenShadArea; inputs bdgs: list of Mesh, vector: Vector3d, massCrvs: list of Curve
# ---------- ghpython_script_4: Python ----------
import Rhino.Geometry as rg
import rhinoscriptsyntax as rs
import ghpythonlib.components as gh

shadowCrv = gh.MeshShadow(bdgs, vector, rg.Plane.WorldXY)
shadowCrv = gh.RegionUnion(shadowCrv)
shadow = gh.BoundarySurfaces(shadowCrv)
shadow = rs.MoveObject(shadow, [0,0,0])


shadowArea = rs.Area(shadow)



try:
    mass1ShadCrv = rs.MoveObject(gh.RegionIntersection(shadowCrv, massCrvs[0], rg.Plane.WorldXY), [0,0,0])
    greenShadCrv = rs.MoveObject(gh.RegionIntersection(shadowCrv, massCrvs[1], rg.Plane.WorldXY), [0,0,0])
    greenShadArea = rs.Area(greenShadCrv)
    mass1ShadArea = rs.Area(mass1ShadCrv)
except:
    greenShadArea = 0
    mass1ShadArea = 0
# ---------- end ghpython_script_4 ----------

# ----
building_s_shadow_area = Panel(ghpython_script_4.shadowArea)
mass1_s_shadow_area = Panel(ghpython_script_4.mass1ShadArea)
green_s_shadow_area = Panel(ghpython_script_4.greenShadArea)
custom_preview = CustomPreview(Geometry=ghpython_script_4.shadow, Material=ColourSwatch(SwatchColor=RGB(69, 69, 69)))
